# Requirement set SystemRequirements (R2018b)

## 1 [#1] Sensors (Container)

### 1.1 [#2] Proximity Sensors
The Self Navigating Robot shall have three digital switch sensors.

## 2 [#5] Actuation (Container)

### 2.1 [#4] Actuation
The Self Navigating Robot shall use two motors for steering and drive control.

## 3 [#6] Control (Container)

### 3.1 [#7] Left-Collision
If the Left Proximity Sensor is triggered, then the Self Navigating Robot shall stop. Reverse. Then turn right 90 degrees before continuing to drive forward.

### 3.2 [#8] Right-Collision
If the Right Proximity Sensor is triggered, then the Self Navigating Robot shall stop. Reverse. Then turn left 90 degrees before continuing to drive forward.

### 3.3 [#9] Front-Collision
If the Front Proximity Sensor is triggered, then the Self Navigating Robot shall stop. Reverse. Then turn right 90 degrees before continuing to drive forward.

### 3.4 [#10] Default Driving
The normal drive control mode shall be for the Self Navigating Robot to drive forwards.